# Dynamo graph Sea Battle.dyn "Minesweeper" (Dynamo 2.0.4.12684)

string = StringInput("main.py")
file_from_path = FileObject(path=string)
readText = FileSystem.ReadText(file=file_from_path)
python_script_from_string = PythonStringNode(script=readText, IN[0]=file_from_path)
